# Grasshopper definition bitSkinGrasshopper.gh (Grasshopper 0.9.75)
# plug-ins: Python Interpreter, Firefly, TT Toolbox

ports_available = COMPortsAvailable()
panel = Panel(ports_available)
int = Integer(panel)
timer = Timer(TimerInterval=50, Target=read)
read = SerialReadGeneric(StartReadingValues=Toggle(True), PortNumber=int)  # -> SerialOutput, StatusMessage
open_port = OpenClosePort(OpenClosePort=Toggle(True), PortNumber=int, BaudRate=9600)

python = PythonScript(x=read.SerialOutput)  # -> out, a, b, c
# ---------- python: Python ----------
ind = x[0:1]
val = x[2:6]


if ind == "a":
    aa = val
    a = aa
elif ind == "b":
    bb = val
    b = bb
    a = aa
elif ind == "c":
    cc = val
    c = cc
    b = bb
    a = aa
# ---------- end python ----------
v = PythonScript(x=python.a)  # -> out, a; inputs x: Int32
# ---------- v: Python ----------
if x < 0 :
    a = 700
else:
    a = (x/12.4)*10
# ---------- end v ----------
L = PythonScript(x=python.c)  # -> out, a; inputs x: Int32
# ---------- L: Python ----------
if x < 0 :
    a = 600
else:
    a = (x/12.4)*10
# ---------- end L ----------
b = PythonScript(x=python.b)  # -> out, a; inputs x: Int32
# ---------- b: Python ----------
if x < 0 :
    a = 860
else:
    a = (x/12.4)*10
# ---------- end b ----------
panel_2 = Panel(read.SerialOutput)
v_2 = Panel(v.a)
b_2 = Panel(b.a)
L_2 = Panel(L.a)

panel_3 = Panel(v_2)
panel_4 = Panel(b_2)
panel_5 = Panel(L_2)
panel_6 = Panel(Slider(44, range=-50..50))
gonna = PythonScript(H="1550", v=panel_3, b=panel_4, l=panel_5, s=panel_6, m="10", z="20", w="30", c="15")  # -> out, x1, y1, x2, y2, x3, y3, x4, y4; inputs H: Int32, v: Int32, b: Int32, l: Int32, s: Int32, m: Int32, z: Int32, w: Int32, c: Int32
# ---------- gonna: Python ----------
ee = 0
eee = 0
ff = (b/4) + s
fff = 0
dd = (b/4) 
ddd = l - (H/10)
bb = (v/4) + z
bbb = l
aa = 0
aaa = l - c
cc = 0 
ccc = l - (H/10)

gg = (v/8) + m 
ggg = l
ii = (v/8)
iii = l - (H/10) + w
hh = (v/8) - m
hhh = l

x1 = ee, ff, dd
y1 = eee, fff, ddd

x3 = dd, bb
y3 = ddd, bbb

x4 = bb, aa
y4 = bbb, aaa

x2 = gg, ii, hh
y2 = ggg, iii, hhh
# ---------- end gonna ----------
int_2 = Integer(gonna.x4)
int_3 = Integer(gonna.y4)
int_4 = Integer(gonna.x3)
int_5 = Integer(gonna.y3)
int_6 = Integer(gonna.x2)
int_7 = Integer(gonna.y2)
int_8 = Integer(gonna.x1)
int_9 = Integer(gonna.y1)
number_slider = Slider(20, range=0..20)
number_slider_2 = Slider(4, range=0..20)
pt = ConstructPoint(XCoordinate=int_2, YCoordinate=int_3, ZCoordinate=0)
pt_2 = ConstructPoint(XCoordinate=int_4, YCoordinate=int_5, ZCoordinate=0)
pt_3 = ConstructPoint(XCoordinate=int_8, YCoordinate=int_9, ZCoordinate=0)
pt_4 = ConstructPoint(XCoordinate=int_6, YCoordinate=int_7, ZCoordinate=0)
multiplication = Multiplication(A=number_slider, B=-1)
item = ListItem(List=pt_2, Index=0, Wrap=True)  # -> Item, Item1
vec = VectorXYZ(XComponent=number_slider_2, YComponent=multiplication, ZComponent=0)  # -> Vector, Length
item_2 = ListItem(List=pt, Index=0, Wrap=True)  # -> Item, Item1
vec_2 = VectorXYZ(XComponent=number_slider_2, YComponent=number_slider, ZComponent=0)  # -> Vector, Length
vec_3 = VectorXYZ(XComponent=Slider(20, range=-20..20), YComponent=Slider(0, range=-20..20), ZComponent=0)  # -> Vector, Length
vec_4 = VectorXYZ(XComponent=Slider(-20, range=-20..20), YComponent=Slider(-6, range=-20..20), ZComponent=0)  # -> Vector, Length
bzspan = BezierSpan(StartPoint=item_2.Item, StartTangent=vec_4.Vector, EndPoint=item_2.Item1, EndTangent=vec_3.Vector)  # -> Curve, Length, Domain
pline = PolyLine(Vertices=pt_3, Closed=False)
pline_2 = PolyLine(Vertices=pt_4, Closed=False)
bzspan_2 = BezierSpan(StartPoint=item.Item, StartTangent=vec_2.Vector, EndPoint=item.Item1, EndTangent=vec.Vector)  # -> Curve, Length, Domain
join = JoinCurves(Curves=[pline, bzspan_2.Curve, bzspan.Curve], Preserve=False)
mirror = Mirror(Geometry=[join, pline_2], Plane=PlaneYZ(0, 0, 0))  # -> Geometry, Transform

l = Slider(13, range=0..20)

x = PythonScript(l=v_2, h=b_2, p=L_2)  # -> out, x, y; inputs l: Int32, h: Int32, p: Int32
# ---------- x: Python ----------
aa=0
bb=l+p
cc=l+p
dd=l+p/2
ee=l+p/2
ff=l+p
gg=l+p
hh=l+p/2
ii=p/2
jj=0
kk=0
ll=p/2
mm=p/2
nn=0


aaa=0
bbb=0
ccc=h
ddd=h
eee=h+p
fff=h+p
ggg=(2*h)+p
hhh=(3*h)+p+20
iii=(3*h)+p+20
jjj=(2*h)+p
kkk=h+p
lll=h+p
mmm=h
nnn=h


x=aa,bb,cc,dd,ee,ff,gg,hh,ii,jj,kk,ll,mm,nn
y=aaa,bbb,ccc,ddd,eee,fff,ggg,hhh,iii,jjj,kkk,lll,mmm,nnn
# ---------- end x ----------
panel_7 = Panel(x.y)
panel_8 = Panel(x.x)
pt_5 = ConstructPoint(XCoordinate=panel_8, YCoordinate=panel_7, ZCoordinate="0")
x_y_z = Panel(pt_5)
tratto = Panel("""10
20""")
orlo = Panel(l)
panel_9 = Panel("""0
12
3
1""")
panel_10 = Panel("""9
11
4
6""")
pline_3 = PolyLine(Vertices=x_y_z, Closed=True)
item_3 = ListItem(List=pt_5, Index=panel_9, Wrap=True)
item_4 = ListItem(List=pt_5, Index=panel_10, Wrap=True)
piegature = PolyLine(Vertices=item_3, Closed=False)
piegature_2 = PolyLine(Vertices=item_4, Closed=True)
orlo_2 = Offset(Curve=pline_3, Distance=orlo, Plane=PlaneXY(0, 0, 0), Corners=1)
dash = DashPattern(Curve=pline_3, Pattern=tratto)  # -> Dashes, Gaps
dash_2 = DashPattern(Curve=piegature_2, Pattern=tratto)  # -> Dashes, Gaps
dash_3 = DashPattern(Curve=piegature, Pattern=tratto)  # -> Dashes, Gaps
crv = Curve(flatten([dash.Dashes, orlo_2, dash_3.Dashes, dash_2.Dashes]))
cadexporter = CADExporter(
    Export=Toggle(False),
    ExportType="dxf",
    FilePaths="C:\Users\stefano\Dropbox\MK\Making\bitSkin",
    FileNames="prova",
    Curves=crv)

crv_2 = Curve(flatten([pline_2, join, mirror.Geometry]))
cadexporter_2 = CADExporter(
    Export=Toggle(False),
    ExportType="dxf",
    FilePaths="C:\Users\stePnox\Dropbox\MK\Making\bitSkin\cartamodelli",
    FileNames="skirt",
    Curves=crv_2)
